# Dynamo graph Calculate Longest Exit Distance.dyn (Dynamo 2.13.0.3135)
# author: Autodesk
# Creates a single Path of Travel from a point (on the perimeter of a room within a project) that has the longest distance to its closest exit.

# group: Path of Travel
# Calculate Longest Exit Distance
# note: See graph properties for more information

# group: Floor Plan View to Use
# Uses the active view (Must be a floor plan view) to calculate the longest exit. Note: The model must have rooms.
current = Document.Current()
activeView = Document.ActiveView(document=current)

# group: START HERE!
# Use the select buttons and select two exit doors in the Revit model. Then press Run in the lower left of the Dynamo applcation window to run the script.
select_exit_door = DSModelElementSelection()  # 1 picked in the model; graph input
select_alternate_exit_door = DSModelElementSelection()  # 1 picked in the model; graph input

# group: Exit points
# Collect list of end points at exits
list_create = List.Create(item0=select_exit_door, item1=select_alternate_exit_door)
boundingBox = Element.BoundingBox(element=list_create)
toCuboid = BoundingBox.ToCuboid(boundingBox=boundingBox)
centroid = Solid.Centroid(solid=toCuboid)

# group: Calculation
# Calculate longest path of travel for current floor plan view
longestOfShortestExitPaths = PathOfTravel.LongestOfShortestExitPaths(floorPlan=activeView, endPtsList=centroid)

longest_exit_path = Watch(longestOfShortestExitPaths)  # graph output
