# Dynamo graph Calculate Room Occupancy Load.dyn (Dynamo 2.13.0.3135)

# group: Calculate Room Occupancy Load
# note: CATEGORY:
# Administration
# DESCRIPTION:
# This workflow will report information about the selected room and its occupancy load based on the allowable number of occupants per unit area.
# MODEL PREPARATION:
# - None
# NOTE:
#  - None
# AUTHORS:
# - Autodesk
# Copyright(c) 2017, Autodesk
# REQUIRED PACKAGES:
# - None

name = Room.Name()  # unwired: room

# group: If set to False units will be converted to Square Feet. If True current project units will be used.
if_set_to_false_units_will_be = BoolSelector(false)  # "If set to False units will be converted to Square Feet. If True current project units will be used."; graph input

select_room = DSModelElementByCategorySelection(index=486)  # nothing selected; graph input
convert_default_square_feet = Python()  # IronPython2
# ---------- convert_default_square_feet.python (16 lines) ----------
# Import DocumentManager and TransactionManager
import clr
clr.AddReference("RevitServices")
import RevitServices
from RevitServices.Persistence import DocumentManager
doc = DocumentManager.Instance.CurrentDBDocument

# Import RevitAPI
clr.AddReference("RevitAPI")
import Autodesk
from Autodesk.Revit.DB import *

value = LabelUtils.GetLabelForUnit(UnitTypeId.SquareFeet)

#Assign your output to the OUT variable.
OUT = value
# ----------------------------------------

# group: Allowable Area per Occupant
allowable_area_per_occupant = DoubleInput(15)  # graph input

# group: Calculate Occupancy Load by dividing Area by Max Floor Area Allowance for given Occupancy Type.
string = StringInput("Area")
# note: Dynamo adopts its display units to whatever Revit project units are set to. We can either convert to Square Feet which feels natural for Occupancy Load Calculations or keep the current display units.
getParameterValueByName = Element.GetParameterValueByName(element=select_room, parameterName=string)
toSquareFeet = Python(IN[0]=getParameterValueByName)  # "ConvertArea.ToSquareFeet"; IronPython2
# ---------- toSquareFeet.python (26 lines) ----------
# Import DocumentManager and TransactionManager
import clr
clr.AddReference("RevitServices")
import RevitServices
from RevitServices.Persistence import DocumentManager
doc = DocumentManager.Instance.CurrentDBDocument

# Import RevitAPI
clr.AddReference("RevitAPI")
import Autodesk
from Autodesk.Revit.DB import *

# Add reference to IronPython Lib folder
import sys
pyt_path = r'C:\Program Files (x86)\IronPython 2.7\Lib'
sys.path.append(pyt_path)

# Set up inputs
value = IN[0]

# Execute definition
projectUnits = Document.GetUnits(doc).GetFormatOptions(SpecTypeId.Area).GetUnitTypeId()
displayUnit = LabelUtils.GetLabelForUnit(projectUnits)

# Assign your output to the OUT variable
OUT = [UnitUtils.Convert(value, projectUnits, UnitTypeId.SquareFeet), displayUnit]
# ----------------------------------------
code_block = CodeBlock(IN=toSquareFeet) { IN[0]; IN[1]; }
if_ = If(test=if_set_to_false_units_will_be, true=getParameterValueByName, false=code_block.out0)
ceiling = Math.Ceiling(number=if_)
div = if_ / allowable_area_per_occupant
ceiling_2 = Math.Ceiling(number=div)

# group: Create Room Occupancy report by joining multiple strings into one.
code_block_2 = CodeBlock { "\n"; "Room Name: "; "Area: ~"; " "; "Occupancy Load: "; }
concat = String.Concat(string0=code_block_2.out1, string1=name)
string_from_object = FromObject(obj=ceiling)
if_2 = If(test=if_set_to_false_units_will_be, true=code_block.out1, false=convert_default_square_feet)
concat_2 = String.Concat(string0=code_block_2.out2, string1=string_from_object, string2=code_block_2.out3, string3=if_2)
string_from_object_2 = FromObject(obj=ceiling_2)
concat_3 = String.Concat(string0=code_block_2.out4, string1=string_from_object_2)
concat_4 = String.Concat(string0=concat, string1=code_block_2.out0, string2=concat_2, string3=code_block_2.out0, string4=code_block_2.out0, string5=concat_3)

if_3 = If(false=concat_4)  # unwired: test, true

# group: Output
calculation_results = Watch(if_3)  # graph output
