# Dynamo graph Update Sheet Names to Upper Case.dyn (Dynamo 2.13.0.3135)
# author: Autodesk
# This workflow sets the names of all Sheets in the model to UPPER CASE.

# group: Sheet Names
# Update to upper case
# note: See graph properties for more information.

# group: Collect
# Collect sheets by category name
select_sheets = ElementTypes("ViewSheet")  # graph input
all_elements_of_type = ElementsOfType(element_type=select_sheets)

# group: Parameter Name
# Sheet name parameter
code_block = CodeBlock { "Sheet Name"; }

# group: Convert Sheet Name
# Convert sheet name to uppercase, then set it.
getParameterValueByName = Element.GetParameterValueByName(element=all_elements_of_type, parameterName=code_block)
toUpper = String.ToUpper(string=getParameterValueByName)

# group: Make Changes/ Return Results
# Set the sheet names to uppercase and return the result as an output.
setParameterByName = Element.SetParameterByName(element=all_elements_of_type, parameterName=code_block, value=toUpper)
sheets_with_names_converted = Watch(setParameterByName)  # graph output
